# Grasshopper definition 2021.12.02-group_components_by_threshold.gh (Grasshopper 1.0.7)

# ---- group: Goto ParametricCamp's Reference Video
python = GhPythonScript(url="https://www.youtube.com/watch?v=ChEfBj8oDB0", go=Button())
# ---------- python: Python ----------
import webbrowser
if url and go: webbrowser.open(url, 1)
# ---------- end python ----------

# ----
python_2 = GhPythonScript(threshold=Slider(3, range=0..10), message="Dangerous Components!", runscript=Button())
# ---------- python_2: Python ----------
"""
    Inputs:
        threshold (int) : Threshold in milliseconds
        message (str)   : Group name (NickName)
        runscript (bool): Boolean to run script component
"""

# - - - - - - - - RHINO / GRASSHOPPER IMPORTS

import Grasshopper
from System.Drawing import Color

# - - - - - - - - GLOBALS

GrasshopperDocument = ghenv.Component.OnPingDocument()

# - - - - - - - - RUNSCRIPT

def get_heavy_components(threshold=5):
    return [component.InstanceGuid for component in GrasshopperDocument.ActiveObjects() if component.ProcessorTime.Milliseconds > threshold]

def create_new_group(color, nickname, guid_list):
    # Instantiate new GH_Group object
    new_group_object = Grasshopper.Kernel.Special.GH_Group()
    # Create default attributes for the group
    new_group_object.CreateAttributes()
    # Add NickName to group
    new_group_object.NickName = nickname
    # Set group color
    new_group_object.Colour = color
    # Add objects into group.
    for component_guid in guid_list:
        new_group_object.AddObject(component_guid)
    # Add group to Grasshopper canvas and return result
    return GrasshopperDocument.AddObject(new_group_object, False) 


if runscript:

    groupColor = Color.Tomato
    heavy_components = get_heavy_components(threshold)
    print(create_new_group(groupColor, message, heavy_components))
# ---------- end python_2 ----------
c_script = CSharpScript(threshold=Slider(3, range=0..10), message="Dangerous Components!", runscript=Button())  # inputs threshold: Int32, message: String, runscript: Boolean
# ---------- c_script: C# usings ----------
using Grasshopper.Kernel.Special;
using System.Drawing;
# ---------- c_script: C# ----------
    if(runscript == true)
    {
      // Create New GH_Group object
      GH_Group NewGroup = new GH_Group();
      NewGroup.CreateAttributes();
      NewGroup.NickName = message;
      NewGroup.Colour = Color.Tomato;
      
      // Add Objects to Group
      List<Guid> HeavyComponents = new List<Guid>();
      foreach(var component in GrasshopperDocument.ActiveObjects())
        if(component.ProcessorTime.Milliseconds > threshold)
          NewGroup.AddObject(component.InstanceGuid);
     
      GrasshopperDocument.AddObject(NewGroup, false);
    }
# ---------- end c_script ----------
python_3 = GhPythonScript()  # -> out, a
# ---------- python_3: Python ----------
a = [num for num in range(1000)]
# ---------- end python_3 ----------
python_4 = GhPythonScript()  # -> out, a; same code as python_3
python_5 = GhPythonScript()  # -> out, a; same code as python_3
